# Grasshopper definition House_PH.gh (Grasshopper 1.0.7)

pipeline = GeometryPipeline(
    GroupByLayer=False,
    GroupByType=False,
    IncludeHidden=True,
    IncludeLocked=True,
    LayerFilter="Plan",
    NameFilter="*",
    SublayerFiltering=True,
    TypeFilter=1073741848)
roomsolid = HBRoomFromSolid(geo=flatten(pipeline), conditioned=True)  # -> report, rooms; plug-in component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
solveadj = HBSolveAdjacency(rooms=flatten(roomsolid.rooms), run=Toggle(True))  # -> report, adj_rooms; plug-in component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
model = HBModel(rooms=flatten(solveadj.adj_rooms), name="Laka House")  # -> report, model; plug-in component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
path = FilePath("C:\Users\zlata\Desktop\")
dumpobjects = HBDumpObjects(hb_objs=flatten(model.model), name="Laka House", folder=path, indent="2", dump=Toggle(False))  # -> report, hb_file; plug-in component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
write_wufi_xml = HBPHWriteWUFIXML(filename="Laka House", save_folder=path, hb_json_file=dumpobjects.hb_file, write_xml=Toggle(False))  # -> out, xml_file; plug-in component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
